# Dynamo custom node CleanExcelForTextParameter.dyf (Dynamo 2.0.3.8810)
# category: MAW
# Clean up a value from Excel which will go to a Text type parameter, removes nulls and zeros

obj = Input(obj: var[]..[])
code_block = CodeBlock { 0.0; "null"; ""; }
eq = obj == code_block.out0
string_from_object = FromObject(obj=obj)
if_ = If(test=eq, true=code_block.out2, false=string_from_object)
eq_2 = if_ == code_block.out1
if_2 = If(test=eq_2, true=code_block.out2, false=if_)
result = Output(if_2)
