# Dynamo graph Defects to Rooms_script.dyn "Defects to Rooms" (Dynamo 2.6.1.8786)

# group: Get Rooms
categories = Categories("OST_Rooms")
all_elements_of_category = ElementsOfCategory(Category=categories)
string = StringInput("Number")
getParameterValueByName = Element.GetParameterValueByName(element=all_elements_of_category, parameterName=string)

# group: Get Excel Data
file_path = Filename("C:\Users\mwarwick\Studioda\StudioDA - Documents\NZ\WEA 820678 Childrens Hospital\10 Construction\10_5 Defects\Room Schedules\Defects Status.xlsx")
file_from_path = FileObject(path=file_path)
string_2 = StringInput("Room Schedule")
boolean = BoolSelector(false)
importExcel = Data.ImportExcel(file=file_from_path, sheetName=string_2, readAsStrings=boolean)
restOfItems = List.RestOfItems(list=importExcel)
restOfItems_2 = List.RestOfItems(list=restOfItems)
restOfItems_3 = List.RestOfItems(list=restOfItems_2)
restOfItems_4 = List.RestOfItems(list=restOfItems_3)
restOfItems_5 = List.RestOfItems(list=restOfItems_4)

# group: Sort Data by Room
transpose = List.Transpose(lists=restOfItems_5)
code_block = CodeBlock { 1; }
getItemAtIndex = List.GetItemAtIndex(list=transpose, index=code_block)
indexOf = List.IndexOf(list=getItemAtIndex, element=getParameterValueByName)

# group: Save to Model (Rooms)
getItemAtIndex_2 = List.GetItemAtIndex(list=all_elements_of_category, index=indexOf)
code_block_2 = CodeBlock { "Comments"; "Defects Status"; "Defects Count"; "Defects Total"; "Defects Ready"; "Defects Owner"; "Current Status"; }
watch = Watch(transpose)
firstItem = List.FirstItem(list=restOfItems)
firstIndexOf = List.FirstIndexOf(list=firstItem, item=code_block_2.out0)
getItemAtIndex_3 = List.GetItemAtIndex(list=watch, index=firstIndexOf)
cleanExcelForTextParameter = Custom[CleanExcelForTextParameter](obj=getItemAtIndex_3)
setParameterByName = Element.SetParameterByName(element=getItemAtIndex_2, parameterName=code_block_2.out0, value=cleanExcelForTextParameter)
firstIndexOf_2 = List.FirstIndexOf(list=firstItem, item=code_block_2.out1)
getItemAtIndex_4 = List.GetItemAtIndex(list=watch, index=firstIndexOf_2)
firstIndexOf_3 = List.FirstIndexOf(list=firstItem, item=code_block_2.out2)
getItemAtIndex_5 = List.GetItemAtIndex(list=watch, index=firstIndexOf_3)
setParameterByName_2 = Element.SetParameterByName(element=getItemAtIndex_2, parameterName=code_block_2.out2, value=getItemAtIndex_5)
firstIndexOf_4 = List.FirstIndexOf(list=firstItem, item=code_block_2.out3)
getItemAtIndex_6 = List.GetItemAtIndex(list=watch, index=firstIndexOf_4)
setParameterByName_3 = Element.SetParameterByName(element=getItemAtIndex_2, parameterName=code_block_2.out3, value=getItemAtIndex_6)
firstIndexOf_5 = List.FirstIndexOf(list=firstItem, item=code_block_2.out5)
getItemAtIndex_7 = List.GetItemAtIndex(list=watch, index=firstIndexOf_5)
setParameterByName_4 = Element.SetParameterByName(element=getItemAtIndex_2, parameterName=code_block_2.out5, value=getItemAtIndex_7)
firstIndexOf_6 = List.FirstIndexOf(list=firstItem, item=code_block_2.out4)
getItemAtIndex_8 = List.GetItemAtIndex(list=watch, index=firstIndexOf_6)
setParameterByName_5 = Element.SetParameterByName(element=getItemAtIndex_2, parameterName=code_block_2.out4, value=getItemAtIndex_8)
firstIndexOf_7 = List.FirstIndexOf(list=firstItem, item=code_block_2.out6)
getItemAtIndex_9 = List.GetItemAtIndex(list=watch, index=firstIndexOf_7)
cleanExcelForTextParameter_2 = Custom[CleanExcelForTextParameter](obj=getItemAtIndex_9)
setParameterByName_6 = Element.SetParameterByName(element=getItemAtIndex_2, parameterName=code_block_2.out6, value=cleanExcelForTextParameter_2)

cleanExcelForTextParameter_3 = Custom[CleanExcelForTextParameter](obj=getItemAtIndex_4)

# group (continued): Save to Model (Rooms)
setParameterByName_7 = Element.SetParameterByName(element=getItemAtIndex_2, parameterName=code_block_2.out1, value=cleanExcelForTextParameter_3)
